# Grasshopper definition TestGemini.gh (Grasshopper 1.0.8)
# plug-ins: jSwan, GrassBananaPro

trigger = Trigger(Interval=-1000, TimerInterval=1000, Target=viewport_capture_to_gimage)
viewport_capture_to_gimage = ViewportCaptureToGImage(ZoomToCrop=False, MaxGImageSize=Slider(500, range=0..1000), UseGImageWidth=True, ForceRefresh=True)
file_path = FilePath("D:\Desktop\Img.png")
geometry = Geometry([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])
custom_preview = CustomPreview(Geometry=geometry, Material=ColourSwatch(SwatchColor=RGB(242, 242, 242)))
preview_image = PreviewImage(GImage=viewport_capture_to_gimage)
image_mask_painter = ImageMaskPainter(GImage=preview_image, MaskColor=RGB(255, 0, 0), BrushSize=Slider(100, range=0..1000), Reset=False)  # -> MaskedGImage, MaskOnly, Info
preview_image_2 = PreviewImage(FilePath=file_path)
preview_image_3 = PreviewImage(GImage=image_mask_painter.MaskedGImage)
list = ValueList({"1:1", "2:3", "3:2", "3:4", "4:3", "4:5", "5:4", "9:16", "16:9", "21:9"}, selected="16:9")
list_2 = ValueList({"1K", "2K", "4K"}, selected="1K")
panel = Panel("A Beautiful buildings in a crowed city, dramatic realistic lighting. A gian banana like the input img on top of the 2 building")
list_3 = ValueList({"1K", "2K", "4K"}, selected="1K")
list_4 = ValueList({"1:1", "2:3", "3:2", "3:4", "4:3", "4:5", "5:4", "9:16", "16:9", "21:9"}, selected="16:9")
gemini_image_generator = GeminiImageGenerator(
    Prompt=panel,
    InputImages=flatten([preview_image, preview_image_2]),
    ImageSize=list_2,
    AspectRatio=list,
    Generate=Button())  # -> GImage, Text, Status, RawResponse
deserialize_json = DeserializeJson(JSON=gemini_image_generator.RawResponse, OutputsLocked=False)  # -> Candidates, UsageMetadata, ModelVersion, ResponseId
panel_2 = Panel(deserialize_json.UsageMetadata)
panel_3 = Panel(deserialize_json.ModelVersion)
panel_4 = Panel(gemini_image_generator.Text)
panel_5 = Panel(gemini_image_generator.Status)
gemini_image_generator_2 = GeminiImageGenerator(
    Prompt="add one big banana in the red area",
    InputImages=preview_image_3,
    ImageSize=list_3,
    AspectRatio=list_4,
    Generate=Button())  # -> GImage, Text, Status, RawResponse
panel_6 = Panel(deserialize_json.ResponseId)
preview_image_4 = PreviewImage(GImage=gemini_image_generator.GImage)
preview_image_5 = PreviewImage(GImage=gemini_image_generator_2.GImage)
export_gimage = ExportGImage(GImage=preview_image_4, FolderPath="D:\Desktop", FileName=panel_6, Export=Button(), Overwrite=False)
panel_7 = Panel(export_gimage)
